# Grasshopper definition KR10-MSPE-B1-IOextrusion.gh (Grasshopper 1.0.7)
# plug-ins: KUKA|prc - parametric robot control

# ---- group: Curves In
number_slider = Slider(50, range=1..100)
series = Series(Start=0, Step=Slider(200, range=0..1000), Count=Slider(3, range=0..10))
circle = Circle(Plane=PlaneXY(0, 0, 0), Radius=number_slider)
series_2 = Series(Start=0, Step=Slider(2, range=0..1000), Count=Slider(50, range=0..500))
unit_x = UnitX(Factor=series)
rotate = Rotate(Geometry=circle, Angle=Slider(90, range=0..100), Plane=PlaneXY(0, 0, 0))  # -> Geometry, Transform
unit_z = UnitZ(Factor=series_2)  # -> graft(UnitVector)
move = Move(Geometry=rotate.Geometry, Motion=unit_x)  # -> Geometry, Transform
move_2 = Move(Geometry=move.Geometry, Motion=unit_z)  # -> Geometry, Transform

number_slider_2 = Slider(52, range=1..100)  # disabled
number_slider_3 = Slider(200, range=0..1000)  # disabled
number_slider_4 = Slider(3, range=0..10)  # disabled
number_slider_5 = Slider(10, range=0..500)  # disabled
number_slider_6 = Slider(2, range=0..1000)  # disabled
number_slider_7 = Slider(0, range=0..100)  # disabled
series_3 = Series(Start=0, Step=number_slider_3, Count=number_slider_4)  # disabled
circle_2 = Circle(Plane=PlaneXY(0, 0, 0), Radius=number_slider_2)  # disabled
series_4 = Series(Start=0, Step=number_slider_6, Count=number_slider_5)  # disabled
unit_x_2 = UnitX(Factor=series_3)  # disabled
rotate_2 = Rotate(Geometry=circle_2, Angle=number_slider_7, Plane=PlaneXY(0, 0, 0))  # -> Geometry, Transform; disabled
unit_z_2 = UnitZ(Factor=series_4)  # -> graft(UnitVector); disabled
move_3 = Move(Geometry=rotate_2.Geometry, Motion=unit_x_2)  # -> Geometry, Transform; disabled
move_4 = Move(Geometry=move_3.Geometry, Motion=unit_z_2)  # -> Geometry, Transform; disabled

# ----
curve = Curve([<curve referenced from the Rhino model> x52])

# ---- group: sort curves by Z
end_points = EndPoints(Curve=curve)  # -> Start, End
deconstruct = Deconstruct(Point=end_points.End)  # -> XComponent, YComponent, ZComponent
sort_list = SortList(Keys=deconstruct.ZComponent, ValuesValuesA=curve)  # -> Keys, ValuesValuesA

# ----
unit_x_3 = UnitX(Factor=number_slider)
move_5 = Move(Geometry=move_2.Geometry, Motion=unit_x_3)  # -> Geometry, Transform
travel_speed = Slider(0.5, range=0..1)

# ---- group: close curve
circle_resolution = Slider(8, range=0..64)
divide_curve = DivideCurve(Curve=sort_list.ValuesValuesA, Count=circle_resolution, Kinks=False)  # -> Points, Tangents, Parameters
list_item = ListItem(List=divide_curve.Points, Index=Slider(0, range=0..100), Wrap=True)

# ---- group: close curve / add aproach and retract
retract_offset = Slider(5, range=0..300)
unit_z_3 = UnitZ(Factor=retract_offset)
move_6 = Move(Geometry=list_item, Motion=unit_z_3)  # -> Geometry, Transform

# ----
list_length = ListLength(List=divide_curve.Points)
merge = Merge(Data1=divide_curve.Points, Data2=list_item)
panel = Panel(list_length)

# ---- group: close curve (continued)
xy_plane = XYPlane(Origin=merge)

# ----
weave = Weave(Pattern=[0, 1], Stream0=move_6.Geometry, Stream1=list_item, NullGaps=False)
xy_plane_2 = XYPlane(Origin=weave)

print_speed = Slider(0.05, range=0..0.1)
linear_movement_kuka_prc = LINearMovementKUKAPrc(TargetAsPlane=xy_plane, Speed=print_speed, extaxenabled=False, interpolation="C_DIS")
digital_output_kuka_prc = DigitalOutputKUKAPrc(DigitalOutputNumber=Slider(1, range=0..1), OutputState=Toggle(True), ContinuousMovement=False, ToolState=-1)  # -> graft(KUKAPrcCommand)
digital_output_kuka_prc_2 = DigitalOutputKUKAPrc(DigitalOutputNumber=Slider(1, range=0..1), OutputState=Toggle(False), ContinuousMovement=False, ToolState=-1)  # -> graft(KUKAPrcCommand)

linear_movement_kuka_prc_2 = LINearMovementKUKAPrc(TargetAsPlane=xy_plane_2, Speed=travel_speed, extaxenabled=False, interpolation="C_DIS")
list_item_2 = ListItem(List=flatten(xy_plane_2), Index=0, Wrap=True)  # disabled
dispatch = Dispatch(List=linear_movement_kuka_prc_2, DispatchPattern=[True, False])  # -> ListA, ListB
list_length_2 = ListLength(List=linear_movement_kuka_prc)
insert_items = InsertItems(List=linear_movement_kuka_prc, Item=dispatch.ListA, Indices=expr("x+1", list_length_2), Wrap=True)
list_length_3 = ListLength(List=insert_items)
insert_items_2 = InsertItems(List=insert_items, Item=dispatch.ListA, Indices=list_length_3, Wrap=True)
panel_2 = Panel(insert_items_2)
list_length_4 = ListLength(List=insert_items_2)
insert_items_3 = InsertItems(List=insert_items_2, Item=digital_output_kuka_prc, Indices=expr("x+3", list_length_4), Wrap=True)
list_length_5 = ListLength(List=insert_items_3)
insert_items_4 = InsertItems(List=insert_items_3, Item=digital_output_kuka_prc_2, Indices=expr("x-1", list_length_5), Wrap=True)
panel_3 = Panel(insert_items_4)
flatten_tree = FlattenTree(Tree=insert_items_4, Path="{0}")

# ---- group: PRC SETUP
geometry = Geometry(<mesh referenced from the Rhino model>)
custom_tool_kuka_prc = CustomToolKUKAPrc(
    CustomToolGeometry=geometry,
    isExternal=False,
    toolid=2,
    toolvala=0,
    toolvalb=0,
    toolvalc=0,
    toolvalx=224.926,
    toolvaly=-12.968,
    toolvalz=86.87,
    valuesset=True)
agilus_kr6_10_r1100_robot = AgilusKR610R1100Robot(infiniterot=False)
kuka_prc_core = KUKAPrcCORE(
    SimulationSlider=Slider(0.371, range=0..1),
    KUKAPrcCommands=flatten_tree,
    Tool=custom_tool_kuka_prc,
    Robot=agilus_kr6_10_r1100_robot,
    PRC_BaseExpose=False,
    PRC_SaveNameExpose=False,
    PRCsettings="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")  # -> RobotGeometry, AnalysisOutput

# ---- group: close curve
circle_resolution_2 = Slider(8, range=0..64)  # disabled
number_slider_8 = Slider(0, range=0..100)  # disabled
divide_curve_2 = DivideCurve(Curve=move_4.Geometry, Count=circle_resolution_2, Kinks=False)  # -> Points, Tangents, Parameters; disabled
list_item_3 = ListItem(List=divide_curve_2.Points, Index=number_slider_8, Wrap=True)  # disabled
merge_2 = Merge(Data1=divide_curve_2.Points, Data2=list_item_3)  # disabled

# ---- group: close curve / add aproach and retract
number_slider_9 = Slider(36, range=0..300)  # disabled
unit_z_4 = UnitZ(Factor=number_slider_9)  # disabled
move_7 = Move(Geometry=list_item_3, Motion=unit_z_4)  # -> Geometry, Transform; disabled

# ---- group: close curve (continued)
merge_3 = Merge(Data1=move_7.Geometry, Data2=merge_2, Data3=move_7.Geometry)  # disabled
xy_plane_3 = XYPlane(Origin=merge_3)  # -> flatten(Plane); disabled

# ----
number_slider_10 = Slider(1, range=0..1)  # disabled
number_slider_11 = Slider(1, range=0..1)  # disabled
boolean_toggle = BooleanToggle(False)  # disabled
number_slider_12 = Slider(0.05, range=0..0.1)  # disabled
boolean_toggle_2 = BooleanToggle(True)  # disabled
digital_output_kuka_prc_3 = DigitalOutputKUKAPrc(DigitalOutputNumber=number_slider_10, OutputState=boolean_toggle, ContinuousMovement=False, ToolState=-1)  # -> graft(KUKAPrcCommand); disabled
digital_output_kuka_prc_4 = DigitalOutputKUKAPrc(DigitalOutputNumber=number_slider_11, OutputState=boolean_toggle_2, ContinuousMovement=False, ToolState=-1)  # -> graft(KUKAPrcCommand); disabled
linear_movement_kuka_prc_3 = LINearMovementKUKAPrc(TargetAsPlane=xy_plane_3, Speed=number_slider_12, extaxenabled=False, interpolation="C_DIS")  # disabled

# ---- group: PRC SETUP
geometry_2 = Geometry(<mesh referenced from the Rhino model>)  # disabled
custom_tool_kuka_prc_2 = CustomToolKUKAPrc(
    CustomToolGeometry=geometry_2,
    isExternal=False,
    toolid=2,
    toolvala=0,
    toolvalb=0,
    toolvalc=0,
    toolvalx=224.926,
    toolvaly=-12.968,
    toolvalz=86.87,
    valuesset=True)  # disabled
number_slider_13 = Slider(0.244, range=0..1)  # disabled
agilus_kr6_10_r1100_robot_2 = AgilusKR610R1100Robot(infiniterot=False)  # disabled
kuka_prc_core_2 = KUKAPrcCORE(
    SimulationSlider=number_slider_13,
    KUKAPrcCommands=linear_movement_kuka_prc_3,
    Tool=custom_tool_kuka_prc_2,
    Robot=agilus_kr6_10_r1100_robot_2,
    PRC_BaseExpose=False,
    PRC_SaveNameExpose=False,
    PRCsettings="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")  # -> RobotGeometry, AnalysisOutput; disabled
