# Grasshopper definition non_planar_test.gh (Grasshopper 1.0.7)

crv = Curve(<curve referenced from the Rhino model>)
crv_2 = Curve(<curve referenced from the Rhino model>)
crv_3 = Curve(<curve referenced from the Rhino model>)
loft_opt = LoftOptions(Closed=False, Adjust=False, Rebuild=0, Refit=0, Type=1)
number_slider = Slider(150, range=3..500)
loft = Loft(Curves=[crv, crv_2, crv_3], Options=loft_opt)
sdivide = DivideSurface(Surface=loft, UCount=Slider(18, range=3..500), VCount=number_slider)  # -> Points, Normals, Parameters
item = ListItem(List=sdivide.Points, Index=expr("x*.75", number_slider), Wrap=True)
item_2 = ListItem(List=sdivide.Points, Index=expr("x/4", number_slider), Wrap=True)
pline = PolyLine(Vertices=sdivide.Points, Closed=False)
area = Area(Geometry=pline)  # -> Area, Centroid
pt = Point(item_2)
pt_2 = Point(item)
pt_3 = Point(area.Centroid)
divide = DivideCurve(Curve=pline, Count=Slider(5, range=3..200), Kinks=False)  # -> Points, Tangents, Parameters
pl_3pt = Plane3Pt(PointA=pt_3, PointB=pt, PointC=pt_2)
pl_origin = PlaneOrigin(Base=pl_3pt, Origin=divide.Points)  # -> flatten(Plane)
pflip = FlipPlane(Plane=pl_origin, ReverseX=False, ReverseY=False, SwapAxes=True)
