# Grasshopper definition template_drawing_2D_3D_surface.gh (Grasshopper 1.0.7)

# ---- group: Create or Add Your Curves
number_slider = Slider(150, range=10..300)
cir = Circle(Plane=PlaneXY(0, 0, 0), Radius=expr("x/2", number_slider))
cir_2 = Circle(Plane=PlaneXY(0, 0, 0), Radius=number_slider)
crv = Curve([cir_2, cir])
crv_2 = Curve([<curve referenced from the Rhino model> x17])
crv_3 = Curve(crv_2)

# ---- group: Source Surface
pt = Point(<point referenced from the Rhino model>)
pt_2 = Point(<point referenced from the Rhino model>)
pt_3 = Point(<point referenced from the Rhino model>)
pt_4 = Point(<point referenced from the Rhino model>)
srf4pt = _4PointSurface(CornerA=pt, CornerB=pt_2, CornerC=pt_3, CornerD=pt_4)
points = PointList(Points=[pt, pt_2, pt_3, pt_4], Size=Slider(46, range=1..100))
flip = Flip(Surface=srf4pt)  # -> Surface, Result

# ---- group: Target Surface
pt_5 = Point(<point referenced from the Rhino model>)
pt_6 = Point(<point referenced from the Rhino model>)
pt_7 = Point(<point referenced from the Rhino model>)
pt_8 = Point(<point referenced from the Rhino model>)
srf4pt_2 = _4PointSurface(CornerA=pt_5, CornerB=pt_6, CornerC=pt_7, CornerD=pt_8)
points_2 = PointList(Points=[pt_5, pt_6, pt_7, pt_8], Size=Slider(46, range=1..100))
flip_2 = Flip(Surface=srf4pt_2)  # -> Surface, Result

# ---- group: Curves Mapped to Target Surface
curves_to_draw = Curve(crv_3)
source_surface = Surface(flip.Surface)
target_surface = Surface(flip_2.Surface)
map_srf = MapToSurface(Curve=curves_to_draw, Source=source_surface, Target=target_surface)
mapped_curves = Curve(map_srf)

# ---- group: Generate Points from Curves
mapped_curves_2 = Curve(mapped_curves)
divide = DivideCurve(Curve=mapped_curves_2, Count=Slider(100, range=1..100), Kinks=False)  # -> Points, Tangents, Parameters
lng = ListLength(List=divide.Points)
startpt = ListItem(List=divide.Points, Index=0, Wrap=True)
ins = InsertItems(List=divide.Points, Item=startpt, Indices=lng, Wrap=False)
points_to_draw = Point(ins)

# ---- group: Generate Target Planes
points_to_draw_2 = Point(points_to_draw)
target_surface_2 = Surface(target_surface)
srf_cp = SurfaceClosestPoint(Point=points_to_draw_2, Surface=target_surface_2)  # -> Point, UVPoint, Distance
evalsrf = EvaluateSurface(Surface=target_surface_2, Point=srf_cp.UVPoint)  # -> Point, Normal, UDirection, VDirection, Frame
pl = PlaneNormal(Origin=evalsrf.Point, ZAxis=evalsrf.Normal)
target_planes = Plane(pl)

# ---- group: Add Approach & Retract Planes
target_planes_2 = Plane(target_planes)
number_slider_2 = Slider(1, range=0..300)
lng_2 = ListLength(List=target_planes_2)
endpt = ListItem(List=target_planes_2, Index=expr("x-1", lng_2), Wrap=False)
startpt_2 = ListItem(List=target_planes_2, Index=0, Wrap=True)
approach_plane = PlaneOffset(BasePlane=startpt_2, Offset=number_slider_2)
retract_plane = PlaneOffset(BasePlane=endpt, Offset=number_slider_2)

# ---- group: Combine into Final Set of Target Planes
approach_planes = Plane(approach_plane)
retract_planes = Plane(approach_plane)
target_planes_3 = Plane(target_planes)

# ----
all_target_planes = Plane([approach_planes, target_planes_3, retract_planes])

# ---- group: Visualize Toolpaths
deplane = DeconstructPlane(Plane=all_target_planes)  # -> Origin, XAxis, YAxis, ZAxis
intcrv = Interpolate(Vertices=deplane.Origin, Degree=1, Periodic=False, KnotStyle=1)  # -> Curve, Length, Domain
points_3 = PointList(Points=deplane.Origin, Size=Slider(8, range=1..100))

# ---- group: Custum constant plane
pt_9 = ConstructPoint(XCoordinate=Slider(0, range=-1..1), YCoordinate=Slider(0, range=-1..1), ZCoordinate=Slider(1, range=-1..1))
pt_10 = Point(Point(0, 0, 0))
vec2pt = Vector2Pt(PointA=pt_10, PointB=pt_9, Unitize=False)  # -> Vector, Length
pl_2 = PlaneNormal(Origin=Point(0, 0, 0), ZAxis=pt_9)
deplane_2 = DeconstructPlane(Plane=pl_2)  # -> Origin, XAxis, YAxis, ZAxis
vec2pt_2 = Vector2Pt(PointA=deplane_2.Origin, PointB=deplane.Origin, Unitize=False)  # -> Vector, Length
move = Move(Geometry=pl_2, Motion=vec2pt_2.Vector)  # -> Geometry, Transform

# ---- group: Combine into Final Set of Target Planes / Toggle TRUE to Lock Orientation to aTarget Plane / Target Orientation Plane
align = AlignPlanes(Planes=all_target_planes, Master=pl_2)

# ---- group: Combine into Final Set of Target Planes / Toggle TRUE to Lock Orientation to aTarget Plane
c_script = CSharpScript(x=Toggle(True), original_planes=all_target_planes, aligned_planes=move.Geometry)  # -> out, A; inputs x: Boolean, original_planes: list of Plane, aligned_planes: list of Plane
# ---------- c_script: C# ----------
bool val = x;

if (val == false)
{
  A = original_planes;
}
else
{
  A = aligned_planes;
}
# ---------- end c_script ----------

# ----
final_target_planes = Plane(c_script.A)
