# Grasshopper definition starttemplate.gh (Grasshopper 1.0.7)
# plug-ins: Robots

pt_c = Panel("-157,-967.5,-60")
pt_d = Panel("236,-974,-55")
pt_b = Panel("-156.5,-736,-60")
pt_a = Panel("238, -739,-56")
new_pt_c = Panel("-250,-1063,-60")
new_pt_d = Panel("129,-1063,-55")
new_pt_b = Panel("-247,-838,-60")
point = Point(new_pt_d)
point_2 = Point(new_pt_c)
point_3 = Point(new_pt_b)
point_4 = Point("144,-836,-56")
pt_c_2 = Panel("-967.5,-157,-60")
_4point_surface = _4PointSurface(CornerA=point_4, CornerB=point_3, CornerC=point_2, CornerD=point)
pt_d_2 = Panel("-174,236,-55")
pt_b_2 = Panel("-736,-156.5,-60")
pt_a_2 = Panel(" -739,238,-56")
area = Area(Geometry=_4point_surface)  # -> Area, Centroid
number_slider = Slider(10, range=0..10)
pt_b_3 = Point(pt_b_2)
pt_b_4 = Point(pt_c_2)
point_5 = Point(pt_a_2)
pt_b_5 = Point(pt_d_2)
circle_cnr = CircleCNR(Center=area.Centroid, Normal=Vector(0, 0, 1), Radius=Slider(50, range=0..100))
number_slider_2 = Slider(1, range=0..100)
series = Series(Start=Slider(1, range=0..1), Step=Slider(1, range=0..1), Count=Slider(50, range=0..100))
unit_z = UnitZ(Factor=series)
move = Move(Geometry=circle_cnr, Motion=unit_z)  # -> Geometry, Transform
panel = Panel(series)

# ---- group: toolpath (polyline)
curve = Curve(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)
control_polygon = ControlPolygon(Curve=curve)  # -> Polygon, Points
xy_plane = XYPlane(Origin=control_polygon.Points)
flip_plane = FlipPlane(Plane=xy_plane, ReverseX=False, ReverseY=False, SwapAxes=True)

# ---- group: toolpath
number_slider_3 = Slider(100, range=0..100)
xy_plane_2 = XYPlane(Origin=Point(0, 0, 0))
point_6 = Point(Point(65.92324287, -725.0983888, 83.4238132))
circle_cnr_2 = CircleCNR(Center=point_6, Normal=xy_plane_2, Radius=number_slider_3)
divide_curve = DivideCurve(Curve=flatten(move.Geometry), Count=Slider(50, range=0..1000), Kinks=False)  # -> Points, Tangents, Parameters
xy_plane_3 = XYPlane(Origin=divide_curve.Points)
flip_plane_2 = FlipPlane(Plane=xy_plane_3, ReverseX=False, ReverseY=False, SwapAxes=True)

# ----
construct_domain = ConstructDomain(DomainStart=number_slider_3, DomainEnd=expr("x*-1", number_slider_3))
xy_plane_4 = XYPlane(Origin=point_6)
plane_surface = PlaneSurface(Plane=xy_plane_4, XSize=construct_domain, YSize=construct_domain)

# ---- group: Point D
construct_point = ConstructPoint(XCoordinate=Slider(0, range=0..1000), YCoordinate=Slider(200, range=0..1000), ZCoordinate=Slider(0, range=0..1000))

# ---- group: Point C
construct_point_2 = ConstructPoint(XCoordinate=Slider(200, range=0..1000), YCoordinate=Slider(200, range=0..1000), ZCoordinate=Slider(0, range=0..1000))

# ---- group: Point B
construct_point_3 = ConstructPoint(XCoordinate=Slider(200, range=0..1000), YCoordinate=Slider(0, range=0..1000), ZCoordinate=Slider(0, range=0..1000))

# ---- group: Point A
construct_point_4 = ConstructPoint(XCoordinate=Slider(0, range=0..1000), YCoordinate=Slider(0, range=0..1000), ZCoordinate=Slider(0, range=0..1000))

# ----
_4point_surface_2 = _4PointSurface(CornerA=construct_point_4, CornerB=construct_point_3, CornerC=construct_point_2, CornerD=construct_point)

# ---- group: Robot setup
xy_plane_5 = XYPlane(Origin=Point(0, 0, 0))
line = Line(Line((0, 0, 0), (0, 0, 84.60529284)))
list = RobotsLibrary({"UR3e", "UR5e", "UR10e", "UR16e", "UR3", "UR5", "UR10"}, selected="UR10e", Type=0)
rotate_axis = RotateAxis(Geometry=xy_plane_5, Angle=Slider(90, range=-180..180), Axis=line)  # -> Geometry, Transform
load_robot_system = LoadRobotSystem(Name=list, Base=xy_plane_5)

# ----
area_2 = Area(Geometry=_4point_surface_2)  # -> Area, Centroid
point_7 = Point(<point referenced from the Rhino model>)
vector_2pt = Vector2Pt(PointA=area_2.Centroid, PointB=point_7, Unitize=False)  # -> Vector, Length
move_2 = Move(Geometry=_4point_surface_2, Motion=vector_2pt.Vector)  # -> Geometry, Transform

# ---- group: make targets
list_2 = FlagFields({"Shoulder": 1, "Elbow": 2, "Wrist": 4}, selected=[])
create_tool = CreateTool(Name="claye", TCP="-95.39,0.87,87.03", Weight=0)  # -> Tool, TCP
list_3 = ValueList({"Joint", "Linear"}, selected="Linear")
create_target = CreateTarget(
    Plane=flip_plane_2,
    RobConf=list_2,
    Motion=list_3,
    Tool=create_tool.Tool,
    Zone=Slider(1, range=-0.9..10),
    IsCartesian=True)

# ----
map_to_surface = MapToSurface(Curve=circle_cnr_2, Source=plane_surface, Target=move_2.Geometry)
message = Message(Message="Ready?")

# ---- group: make program
create_program = CreateProgram(Name="test", RobotSystem=load_robot_system, Targets=create_target, InitCommands=message, StepSize=1)  # -> Program, Code, Duration, Warnings, Errors
program_simulation = ProgramSimulation(Program=create_program.Program, Time=Slider(1, range=0.001..1), Normalized=True)  # -> SystemMeshes, JointRotations, Plane, Index, Time, Program, Errors
panel_2 = Panel([create_program.Errors, create_program.Warnings])

# ----
panel_3 = Panel(create_program.Code)
degrees = Degrees(Radians=program_simulation.JointRotations)

# ---- group: remote control
remote_connection = RemoteConnection(Program=program_simulation.Program, IP="192.168.1.10", Upload=Button(), Play=Button(), Pause=Button())
panel_4 = Panel(degrees)

# ----
panel_5 = Panel(remote_connection)
