# Grasshopper definition wasptemplate.gh (Grasshopper 1.0.7)
# plug-ins: KUKA|prc - parametric robot control

# ---- group: Gcode import worksflow
# Introduction to Robotic 3D printing
# WASP template
# Notes: You can double click this and add your class notes here !
number_slider = Slider(0.5, range=0.5..2)
pt = Point(<point referenced from the Rhino model>)
path = FilePath("C:\Users\luigi\Desktop\interblock1.gcode")
import_g_code = GCodeImportFor3DPrintingKUKAPrc(
    Path=path,
    TolerancePointsInCartesianSpace=number_slider,
    ToleranceExtrusionSpeed=0,
    ExtrusionMode="E2",
    OrientationPoint=Point(-557.0726175, -228.5483526, 0),
    interpolation="C_DIS")

# ----
curve = Curve(<curve referenced from the Rhino model>)
control_points = ControlPoints(Curve=curve)  # -> Points, Weights, Knots
list_item = ListItem(List=control_points.Points, Index=0, Wrap=True)
xy_plane = XYPlane(Origin=[control_points.Points, list_item])
linear_movement_kuka_prc = LINearMovementKUKAPrc(TargetAsPlane=xy_plane, extaxenabled=False, interpolation="C_DIS")
kr30_60_ha_robot = KR3060HARobot(infiniterot=False)

# ---- group: PRC SETUP
geo = Geometry(<mesh referenced from the Rhino model>)
custom_tool = CustomToolKUKAPrc(
    CustomToolGeometry=geo,
    isExternal=False,
    toolid=5,
    toolvala=0,
    toolvalb=0,
    toolvalc=0,
    toolvalx=380,
    toolvaly=-4.3,
    toolvalz=85.3,
    valuesset=True)
kuka_prc = KUKAPrcCORE(
    SimulationSlider=Slider(0.494, range=0..1),
    KUKAPrcCommands=linear_movement_kuka_prc,
    Tool=custom_tool,
    Robot=kr30_60_ha_robot,
    PRC_BaseExpose=False,
    PRC_SaveNameExpose=False,
    PRCsettings="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")  # -> RobotGeometry, AnalysisOutput
