# Grasshopper definition KR10-MSPE-B1.gh (Grasshopper 1.0.7)
# plug-ins: KUKA|prc - parametric robot control, Python

# ---- group: Blender MeshSync workflow
path = FilePath("G:\My Drive\Selflearn\blender\sverchok\large_vertices.txt")
meshsync_import = MeshSyncImport(Import=Toggle(True), Path=path)  # -> Mesh, Verts, Edges, Faces
vec = VectorXYZ(XComponent="200", YComponent="100", ZComponent="0")  # -> Vector, Length
scale = Scale(Geometry=meshsync_import.Verts, Center=Point(0, 0, 0), Factor=Slider(10, range=0..100))  # -> Geometry, Transform
vec_2 = Vector(vec.Vector)
move = Move(Geometry=scale.Geometry, Motion=vec_2)  # -> Geometry, Transform
lin_move = LINearMovementKUKAPrc(TargetAsPlane=move.Geometry, extaxenabled=False, interpolation="C_DIS")

# ---- group: Gcode import worksflow
pt = Point(<point referenced from the Rhino model>)
path_2 = FilePath("G:\My Drive\FIU\projects\Peeler_knockoff.gcode")
import_g_code = GCodeImportFor3DPrintingKUKAPrc(
    Path=path_2,
    TolerancePointsInCartesianSpace=Slider(0.5, range=0.5..2),
    ToleranceExtrusionSpeed=0,
    ExtrusionMode="E1",
    OrientationPoint=pt,
    interpolation="C_DIS")

# ---- group: Simple curve
crv = Curve(<curve referenced from the Rhino model>)
divide = DivideCurve(Curve=crv, Count=10, Kinks=False)  # -> Points, Tangents, Parameters
xy = XYPlane(Origin=divide.Points)
lin_move_2 = LINearMovementKUKAPrc(TargetAsPlane=xy, extaxenabled=False, interpolation="C_DIS")

# ---- group: PRC SETUP
geo = Geometry(<mesh referenced from the Rhino model>)
custom_tool = CustomToolKUKAPrc(
    CustomToolGeometry=geo,
    isExternal=False,
    toolid=2,
    toolvala=0,
    toolvalb=0,
    toolvalc=0,
    toolvalx=224.926,
    toolvaly=-12.968,
    toolvalz=86.87,
    valuesset=True)
kr6_10_r1100 = AgilusKR610R1100Robot(infiniterot=False)
kuka_prc = KUKAPrcCORE(
    SimulationSlider=Slider(1, range=0..1),
    KUKAPrcCommands=import_g_code,
    Tool=custom_tool,
    Robot=kr6_10_r1100,
    PRC_BaseExpose=False,
    PRC_SaveNameExpose=False,
    PRCsettings="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")  # -> RobotGeometry, AnalysisOutput
