# Grasshopper definition KR10-MSPE-KUKA-PRC.gh (Grasshopper 1.0.7)
# plug-ins: KUKA|prc - parametric robot control

# ---- group: BASIC KUKA|PRC SETUP
geo = Geometry(<mesh referenced from the Rhino model>)
custom_tool = CustomToolKUKAPrc(
    CustomToolGeometry=geo,
    toolid=2,
    toolvala=0,
    toolvalb=0,
    toolvalc=0,
    toolvalx=224.926,
    toolvaly=-12.968,
    toolvalz=86.87,
    valuesset=True)
lin_move = LINearMovementKUKAPrc(extaxenabled=False, interpolation="C_DIS")
kr6_10_r1100 = AgilusKR610R1100Robot(infiniterot=False)
kuka_prc = KUKAPrcCORE(
    SimulationSlider=Slider(1, range=0..1),
    KUKAPrcCommands=lin_move,
    Tool=custom_tool,
    Robot=kr6_10_r1100,
    PRC_BaseExpose=False,
    PRC_SaveNameExpose=False,
    PRCsettings="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")  # -> RobotGeometry, AnalysisOutput
