# Grasshopper definition KR10_template_drawing.gh (Grasshopper 1.0.7)
# plug-ins: KUKA|prc - parametric robot control

# ---- group: Create Your Curves
number_slider = Slider(150, range=10..300)
cir = Circle(Plane=PlaneXY(0, 0, 0), Radius=expr("x/2", number_slider))
cir_2 = Circle(Plane=PlaneXY(0, 0, 0), Radius=number_slider)
crv = Curve([cir, cir_2])

# ----
# Base coordinates
longitude_offset = Slider(710, range=0..1000)
latitude_offset = Slider(76, range=0..1000)
height_offset = Slider(239, range=0..1000)

# ----
# Establish points
# Offset Distance
size = Slider(114, range=0..1000)
addition = Addition(A=latitude_offset, B=size)
addition_2 = Addition(A=longitude_offset, B=size)
addition_3 = Addition(A=latitude_offset, B=size)
addition_4 = Addition(A=longitude_offset, B=size)

# ---- group: Source Surface
pt = Point(<point referenced from the Rhino model>)
pt_2 = Point(<point referenced from the Rhino model>)
pt_3 = Point(<point referenced from the Rhino model>)
pt_4 = Point(<point referenced from the Rhino model>)
srf4pt = _4PointSurface(CornerA=pt, CornerB=pt_2, CornerC=pt_3, CornerD=pt_4)
points = PointList(Points=[pt, pt_2, pt_3, pt_4], Size=Slider(46, range=1..100))
flip = Flip(Surface=srf4pt)  # -> Surface, Result

# ----
cluster = Cluster(
    U_3=longitude_offset,
    V_3=latitude_offset,
    W_3=height_offset,
    U=addition_4,
    V=latitude_offset,
    W=height_offset,
    U_2=addition_2,
    V_2=addition_3,
    W_2=height_offset,
    U_4=longitude_offset,
    V_4=addition,
    W_4=height_offset)  # -> pt_7, pt_5, pt_6, pt_8

# ----
# Pedestal
base_aff = Slider(826, range=0..1000)
Y = Slider(104, range=0..1000)
xy = Slider(457, range=0..1000)
X = Slider(540, range=0..1000)
neg = Negative(Value=Y)
neg_2 = Negative(Value=base_aff)
Z = Slider(1065, range=0..1200)
pt_5 = ConstructPoint(XCoordinate=X, YCoordinate=neg, ZCoordinate=neg_2)
rectangle = Rectangle(Plane=pt_5, XSize=xy, YSize=xy, Radius=0)  # -> Rectangle, Length
boxrec = BoxRectangle(Rectangle=rectangle.Rectangle, Height=Z)

geo = Geometry(<brep referenced from the Rhino model>)

# ---- group: Target Surface
pt_6 = Point(<point referenced from the Rhino model>)
pt_7 = Point(<point referenced from the Rhino model>)
pt_8 = Point(<point referenced from the Rhino model>)
pt_9 = Point(<point referenced from the Rhino model>)
srf4pt_2 = _4PointSurface(CornerA=pt_6, CornerB=pt_7, CornerC=pt_8, CornerD=pt_9)
points_2 = PointList(Points=[pt_6, pt_7, pt_8, pt_9], Size=Slider(46, range=1..100))
flip_2 = Flip(Surface=srf4pt_2)  # -> Surface, Result

# ---- group: Curves Mapped to Target Surface
curves_to_draw = Curve(crv)
source_surface = Surface(flip.Surface)
target_surface = Surface(flip_2.Surface)
map_srf = MapToSurface(Curve=curves_to_draw, Source=source_surface, Target=target_surface)
mapped_curves = Curve(map_srf)

# ---- group: Generate Points from Curves
mapped_curves_2 = Curve(mapped_curves)
divide = DivideCurve(Curve=mapped_curves_2, Count=Slider(29, range=1..100), Kinks=False)  # -> Points, Tangents, Parameters
lng = ListLength(List=divide.Points)
startpt = ListItem(List=divide.Points, Index=0, Wrap=True)
ins = InsertItems(List=divide.Points, Item=startpt, Indices=lng, Wrap=False)
points_to_draw = Point(ins)

# ---- group: Generate Target Planes
points_to_draw_2 = Point(points_to_draw)
target_surface_2 = Surface(target_surface)
srf_cp = SurfaceClosestPoint(Point=points_to_draw_2, Surface=target_surface_2)  # -> Point, UVPoint, Distance
evalsrf = EvaluateSurface(Surface=target_surface_2, Point=srf_cp.UVPoint)  # -> Point, Normal, UDirection, VDirection, Frame
pl = PlaneNormal(Origin=evalsrf.Point, ZAxis=evalsrf.Normal)
target_planes = Plane(pl)

# ---- group: Add Approach & Retract Planes
target_planes_2 = Plane(target_planes)
number_slider_2 = Slider(100, range=0..300)
lng_2 = ListLength(List=target_planes_2)
endpt = ListItem(List=target_planes_2, Index=expr("x-1", lng_2), Wrap=False)
startpt_2 = ListItem(List=target_planes_2, Index=0, Wrap=True)
approach_plane = PlaneOffset(BasePlane=startpt_2, Offset=number_slider_2)
retract_plane = PlaneOffset(BasePlane=endpt, Offset=number_slider_2)

# ---- group: Combine into Final Set of Target Planes
approach_planes = Plane(approach_plane)
retract_planes = Plane(approach_plane)
target_planes_3 = Plane(target_planes)

# ----
all_target_planes = Plane([approach_planes, target_planes_3, retract_planes])

# ---- group: Visualize Toolpaths
deplane = DeconstructPlane(Plane=all_target_planes)  # -> Origin, XAxis, YAxis, ZAxis
intcrv = Interpolate(Vertices=deplane.Origin, Degree=1, Periodic=False, KnotStyle=1)  # -> Curve, Length, Domain
points_3 = PointList(Points=deplane.Origin, Size=Slider(8, range=1..100))

# ----
pt_10 = ConstructPoint(XCoordinate=Slider(0, range=-1..1), YCoordinate=Slider(0, range=-1..1), ZCoordinate=Slider(1, range=-1..1))
pt_11 = Point(Point(0, 0, 0))
vec2pt = Vector2Pt(PointA=pt_11, PointB=pt_10, Unitize=False)  # -> Vector, Length
pl_2 = PlaneNormal(Origin=Point(0, 0, 0), ZAxis=pt_10)
deplane_2 = DeconstructPlane(Plane=pl_2)  # -> Origin, XAxis, YAxis, ZAxis
vec2pt_2 = Vector2Pt(PointA=deplane_2.Origin, PointB=deplane.Origin, Unitize=False)  # -> Vector, Length

# ---- group: Combine into Final Set of Target Planes / Toggle TRUE to Lock Orientation to aTarget Plane / Target Orientation Plane
align = AlignPlanes(Planes=all_target_planes, Master=pl_2)

# ----
move = Move(Geometry=pl_2, Motion=vec2pt_2.Vector)  # -> Geometry, Transform

# ---- group: Combine into Final Set of Target Planes / Toggle TRUE to Lock Orientation to aTarget Plane
c_script = CSharpScript(x=Toggle(True), original_planes=all_target_planes, aligned_planes=move.Geometry)  # -> out, A; inputs x: Boolean, original_planes: list of Plane, aligned_planes: list of Plane
# ---------- c_script: C# ----------
bool val = x;

if (val == false)
{
  A = original_planes;
}
else
{
  A = aligned_planes;
}
# ---------- end c_script ----------

# ----
final_target_planes = Plane(c_script.A)
final_target_planes_2 = Plane(flatten(final_target_planes))

# ----
# Simulation
panel = Panel(".024")
custom_tool = CustomToolKUKAPrc(
    CustomToolGeometry=geo,
    toolid=6,
    toolvala=0,
    toolvalb=0,
    toolvalc=0,
    toolvalx=50,
    toolvaly=0,
    toolvalz=125,
    valuesset=True)
lin_move = LINearMovementKUKAPrc(TargetAsPlane=final_target_planes_2, Speed=panel, extaxenabled=False, interpolation="C_DIS")
kr6_10_r1100 = AgilusKR610R1100Robot(infiniterot=False)
knob = ControlKnob(Decimals=2, Limit=True, Maximum=1, Minimum=0, Range=1, Value=0.04)
kuka_prc = KUKAPrcCORE(
    SimulationSlider=knob,
    KUKAPrcCommands=lin_move,
    Tool=custom_tool,
    Robot=kr6_10_r1100,
    PRC_BaseExpose=False,
    PRC_SaveNameExpose=False,
    PRCsettings="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")  # -> RobotGeometry, AnalysisOutput

# ==== cluster Cluster
U = ClusterInput()
V = ClusterInput()
W = ClusterInput()
U_2 = ClusterInput()
V_2 = ClusterInput()
W_2 = ClusterInput()
U_3 = ClusterInput()
V_3 = ClusterInput()
W_3 = ClusterInput()
U_4 = ClusterInput()
V_4 = ClusterInput()
W_4 = ClusterInput()
pt = PointOriented(BasePlane=PlaneXY(0, 0, 0), UComponent=U, VComponent=V, WComponent=W)
pt_2 = PointOriented(BasePlane=PlaneXY(0, 0, 0), UComponent=U_2, VComponent=V_2, WComponent=W_2)
pt_3 = PointOriented(BasePlane=PlaneXY(0, 0, 0), UComponent=U_3, VComponent=V_3, WComponent=W_3)
pt_4 = PointOriented(BasePlane=PlaneXY(0, 0, 0), UComponent=U_4, VComponent=V_4, WComponent=W_4)
pt_5 = ClusterOutput(pt)
pt_6 = ClusterOutput(pt_2)
pt_7 = ClusterOutput(pt_3)
pt_8 = ClusterOutput(pt_4)
