# Grasshopper definition KR10_template_drawing_vertical.gh (Grasshopper 1.0.7)
# plug-ins: KUKA|prc - parametric robot control

# ---- group: Create Your Curves
number_slider = Slider(150, range=10..300)
cir = Circle(Plane=PlaneXY(0, 0, 0), Radius=expr("x/2", number_slider))
cir_2 = Circle(Plane=PlaneXY(0, 0, 0), Radius=number_slider)
crv = Curve([cir, cir_2])

# ---- group: Calibrated Plane
pt = Point(Point(940.36, 0.11, 695.58))
pt_2 = Point(Point(943.56, -314.37, 261.92))
pt_3 = Point(Point(926.01, 462.93, 261.92))
pl_3pt = Plane3Pt(PointA=pt, PointB=pt_2, PointC=pt_3)
points = PointList(Points=[pt, pt_2, pt_3], Size=Slider(46, range=1..100))

# ---- group: Convert to Surface
number_slider_2 = Slider(521, range=1..1000)
planesrf = PlaneSurface(Plane=pl_3pt, XSize=number_slider_2, YSize=number_slider_2)

# ---- group: Source Surface
pt_4 = Point(<point referenced from the Rhino model>)
pt_5 = Point(<point referenced from the Rhino model>)
pt_6 = Point(<point referenced from the Rhino model>)
pt_7 = Point(<point referenced from the Rhino model>)
srf4pt = _4PointSurface(CornerA=pt_4, CornerB=pt_5, CornerC=pt_6, CornerD=pt_7)
points_2 = PointList(Points=[pt_4, pt_5, pt_6, pt_7], Size=Slider(46, range=1..100))
flip = Flip(Surface=srf4pt)  # -> Surface, Result

# ---- group: Target Surface
pt_8 = Point(<point referenced from the Rhino model>)
pt_9 = Point(<point referenced from the Rhino model>)
pt_10 = Point(<point referenced from the Rhino model>)
pt_11 = Point(<point referenced from the Rhino model>)
srf4pt_2 = _4PointSurface(CornerA=pt_8, CornerB=pt_9, CornerC=pt_10, CornerD=pt_11)
points_3 = PointList(Points=[pt_8, pt_9, pt_10, pt_11], Size=Slider(46, range=1..100))
flip_2 = Flip(Surface=srf4pt_2)  # -> Surface, Result

# ---- group: Rotate Plane / centroid
sdivide = DivideSurface(Surface=planesrf, UCount=2, VCount=2)  # -> flatten(Points), Normals, Parameters
item = ListItem(List=sdivide.Points, Index=Slider(4, range=0..8), Wrap=True)

# ----
crv_2 = Curve([<curve referenced from the Rhino model> x74])
pt_12 = ConstructPoint(XCoordinate=Slider(0.179, range=-1..1), YCoordinate=Slider(-0.327, range=-1..1), ZCoordinate=Slider(-0.02, range=-1..1))
pl = PlaneNormal(Origin=Point(0, 0, 0), ZAxis=pt_12)
deplane = DeconstructPlane(Plane=pl)  # -> Origin, XAxis, YAxis, ZAxis

# ----
# Pedestal
base_aff = Slider(826, range=0..1000)
Y = Slider(104, range=0..1000)
xy = Slider(457, range=0..1000)
X = Slider(540, range=0..1000)
neg = Negative(Value=Y)
neg_2 = Negative(Value=base_aff)
Z = Slider(1065, range=0..1200)
pt_13 = ConstructPoint(XCoordinate=X, YCoordinate=neg, ZCoordinate=neg_2)
rectangle = Rectangle(Plane=pt_13, XSize=xy, YSize=xy, Radius=0)  # -> Rectangle, Length
boxrec = BoxRectangle(Rectangle=rectangle.Rectangle, Height=Z)

geo = Geometry(<brep referenced from the Rhino model>)
save = Button()
wait = WaitKUKAPrc(KUKAPrcWait=0.5)

# ---- group: Fine Tune Positioning
deplane_2 = DeconstructPlane(Plane=planesrf)  # -> Origin, XAxis, YAxis, ZAxis
multiplication = Multiplication(A=deplane_2.XAxis, B=Slider(128.363, range=-1000..1000))
multiplication_2 = Multiplication(A=deplane_2.YAxis, B=Slider(-77.306, range=-1000..1000))
multiplication_3 = Multiplication(A=deplane_2.ZAxis, B=Slider(0, range=-1000..1000))

# ---- group: Rotate Plane
rot3d = Rotate3D(Geometry=planesrf, Angle=degrees(Slider(306, range=0..360)), Center=item, Axis=deplane_2.ZAxis)  # -> Geometry, Transform

# ---- group: Fine Tune Positioning (continued)
move = Move(Geometry=rot3d.Geometry, Motion=multiplication)  # -> Geometry, Transform
move_2 = Move(Geometry=move.Geometry, Motion=multiplication_2)  # -> Geometry, Transform
move_3 = Move(Geometry=move_2.Geometry, Motion=multiplication_3)  # -> Geometry, Transform
flip_3 = Flip(Surface=move_3.Geometry)  # -> Surface, Result

# ----
calibrated_work_srf = Surface(move_3.Geometry)

# ---- group: Curves Mapped to Target Surface
curves_to_draw = Curve(crv_2)
source_surface = Surface(flip.Surface)
target_surface = Surface(calibrated_work_srf)
map_srf = MapToSurface(Curve=curves_to_draw, Source=source_surface, Target=target_surface)
mapped_curves = Curve(map_srf)

# ---- group: Generate Points from Curves
mapped_curves_2 = Curve(mapped_curves)
divdist = DivideDistance(Curve=mapped_curves_2, Distance=Slider(0.73, range=0.01..10))  # -> Points, Tangents, Parameters
lng = ListLength(List=divdist.Points)
startpt = ListItem(List=divdist.Points, Index=0, Wrap=True)
ins = InsertItems(List=divdist.Points, Item=startpt, Indices=lng, Wrap=False)
points_to_draw = Point(divdist.Points)

# ----
intcrv = Interpolate(Vertices=divdist.Points, Degree=1, Periodic=False, KnotStyle=1)  # -> Curve, Length, Domain

# ---- group: Generate Target Planes
points_to_draw_2 = Point(points_to_draw)
target_surface_2 = Surface(target_surface)
srf_cp = SurfaceClosestPoint(Point=points_to_draw_2, Surface=target_surface_2)  # -> Point, UVPoint, Distance
evalsrf = EvaluateSurface(Surface=target_surface_2, Point=srf_cp.UVPoint)  # -> Point, Normal, UDirection, VDirection, Frame
pl_2 = PlaneNormal(Origin=evalsrf.Point, ZAxis=evalsrf.Normal)
target_planes = Plane(pl_2)

# ---- group: Add Approach & Retract Planes
target_planes_2 = Plane(target_planes)
number_slider_3 = Slider(-25, range=-360..360)
lng_2 = ListLength(List=target_planes_2)
endpt = ListItem(List=target_planes_2, Index=expr("x-1", lng_2), Wrap=False)
startpt_2 = ListItem(List=target_planes_2, Index=0, Wrap=True)
approach_plane = PlaneOffset(BasePlane=startpt_2, Offset=number_slider_3)
retract_plane = PlaneOffset(BasePlane=endpt, Offset=number_slider_3)

# ---- group: Combine into Final Set of Target Planes
approach_planes = Plane(approach_plane)
retract_planes = Plane(retract_plane)
target_planes_3 = Plane(target_planes)

# ----
all_target_planes = Plane([approach_planes, target_planes_3, retract_planes])

# ---- group: Visualize Toolpaths
deplane_3 = DeconstructPlane(Plane=all_target_planes)  # -> Origin, XAxis, YAxis, ZAxis
points_4 = PointList(Points=deplane_3.Origin, Size=Slider(8, range=1..100))
intcrv_2 = Interpolate(Vertices=deplane_3.Origin, Degree=1, Periodic=False, KnotStyle=1)  # -> Curve, Length, Domain

# ----
xy_2 = XYPlane(Origin=deplane_3.Origin)
pln = Plane(xy_2)
deplane_4 = DeconstructPlane(Plane=pln)  # -> Origin, XAxis, YAxis, ZAxis

# ---- group: Local X
rot3d_2 = Rotate3D(Geometry=pln, Angle=degrees(Slider(-80, range=-360..360)), Center=deplane_4.Origin, Axis=deplane_4.XAxis)  # -> Geometry, Transform

# ---- group: Local Y
rot3d_3 = Rotate3D(Geometry=rot3d_2.Geometry, Angle=degrees(Slider(-270, range=-360..360)), Center=deplane_4.Origin, Axis=deplane_4.YAxis)  # -> Geometry, Transform

# ----
vec2pt = Vector2Pt(PointA=deplane.Origin, PointB=deplane_3.Origin, Unitize=False)  # -> Vector, Length

# ---- group: Local Z
rot3d_4 = Rotate3D(Geometry=rot3d_3.Geometry, Angle=degrees(Slider(-90, range=-360..360)), Center=deplane_4.Origin, Axis=deplane_4.ZAxis)  # -> Geometry, Transform

# ----
move_4 = Move(Geometry=pl, Motion=vec2pt.Vector)  # -> Geometry, Transform
rotated_planes = Plane(rot3d_4.Geometry)

# ---- group: Combine into Final Set of Target Planes / Toggle TRUE to Lock Orientation to aTarget Plane
c_script = CSharpScript(x=Toggle(True), original_planes=all_target_planes, aligned_planes=rotated_planes)  # -> out, A; inputs x: Boolean, original_planes: list of Plane, aligned_planes: list of Plane
# ---------- c_script: C# ----------
bool val = x;

if (val == false)
{
  A = original_planes;
}
else
{
  A = aligned_planes;
}
# ---------- end c_script ----------

# ----
final_target_planes = Plane(c_script.A)
final_target_planes_2 = Plane(flatten(final_target_planes))

# ----
# Simulation
panel = Panel(".024")
custom_tool = CustomToolKUKAPrc(
    CustomToolGeometry=geo,
    toolid=6,
    toolvala=0,
    toolvalb=0,
    toolvalc=0,
    toolvalx=-89.309,
    toolvaly=11.078,
    toolvalz=137.713,
    valuesset=True)
lin_move = LINearMovementKUKAPrc(TargetAsPlane=final_target_planes_2, Speed=panel, extaxenabled=False, interpolation="C_DIS")
kr6_10_r1100 = AgilusKR610R1100Robot(infiniterot=False)
knob = ControlKnob(Decimals=2, Limit=True, Maximum=1, Minimum=0, Range=1, Value=0.2)

ins_2 = InsertItems(List=lin_move, Item=wait, Indices=2, Wrap=True)

kuka_prc = KUKAPrcCORE(
    SimulationSlider=knob,
    KUKAPrcCommands=ins_2,
    Tool=custom_tool,
    Robot=kr6_10_r1100,
    SaveToggle=save,
    Filename="draw_kukas_7",
    PRC_BaseExpose=False,
    PRC_SaveNameExpose=True,
    PRCsettings="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")  # -> RobotGeometry, AnalysisOutput
