# Grasshopper definition surfacebackandforward.gh (Grasshopper 1.0.8)
# plug-ins: KUKA|prc - parametric robot control

brep = Brep(<brep referenced from the Rhino model>)
unit_z = UnitZ(Factor=1)
surface = Surface(<surface referenced from the Rhino model>)
contour = Contour(Shape=brep, Point=Point(0, 0, 0), Direction=unit_z, Distance=Slider(1.5, range=0..10))  # -> flatten(Contours)
number_slider = Slider(100, range=0..100)
dispatch = Dispatch(List=contour, DispatchPattern=[True, False])  # -> ListA, ListB
divide_curve = DivideCurve(Curve=dispatch.ListA, Count=number_slider, Kinks=False)  # -> simplify(Points), Tangents, Parameters
divide_curve_2 = DivideCurve(Curve=dispatch.ListB, Count=number_slider, Kinks=False)  # -> reverse(simplify(Points)), Tangents, Parameters
merge = Merge(Data1=divide_curve.Points, Data2=divide_curve_2.Points)
xy = XYPlane(Origin=merge)  # -> flatten(Plane)
lin_move = LINearMovementKUKAPrc(TargetAsPlane=xy, extaxenabled=False, interpolation="C_DIS")

# ---- group: PRC SETUP
geo = Geometry(<mesh referenced from the Rhino model>)
custom_tool = CustomToolKUKAPrc(
    CustomToolGeometry=geo,
    isExternal=False,
    toolid=2,
    toolvala=0,
    toolvalb=0,
    toolvalc=0,
    toolvalx=224.926,
    toolvaly=-12.968,
    toolvalz=86.87,
    valuesset=True)
kr6_10_r1100 = AgilusKR610R1100Robot(infiniterot=False)
kuka_prc = KUKAPrcCORE(
    SimulationSlider=Slider(1, range=0..1),
    KUKAPrcCommands=lin_move,
    Tool=custom_tool,
    Robot=kr6_10_r1100,
    PRC_BaseExpose=False,
    PRC_SaveNameExpose=False,
    PRCsettings="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")  # -> RobotGeometry, AnalysisOutput
