# Grasshopper definition test_cylinder.gh (Grasshopper 1.0.7)
# plug-ins: KUKA|prc - parametric robot control

# ---- group: get number of layers
layer_height = Slider(10, range=0..10)
total_height = Slider(150, range=0..500)
division = Division(A=total_height, B=layer_height)
num_layers = Number(division)

# ----
total_height_2 = Integer(total_height)
curve_resolution = Slider(30, range=3..200)
curve_resolution_2 = Integer(curve_resolution)
curve_resolution_3 = Integer(curve_resolution)
curve_resolution_4 = Integer(curve_resolution)
kr10_r1420 = CybertechNanoKR10R1420Robot(infiniterot=False)

# ---- group: test cylinder
pt = ConstructPoint(XCoordinate=Slider(500, range=0..500), YCoordinate=Slider(0, range=0..500), ZCoordinate=Slider(0, range=0..500))

# ----
xy = XYPlane(Origin=pt)

# ---- group: test cylinder (continued)
cyl = Cylinder(Base=xy, Radius=Slider(100, range=0..500), Length=total_height)

# ---- group: create non-planar toolpaths / middle section
pt_2 = ConstructPoint(XCoordinate=0, YCoordinate=0, ZCoordinate=expr("x*.5", total_height_2))
vec = VectorXYZ(XComponent=Slider(0, range=-1..1), YComponent=Slider(0.3, range=-1..1), ZComponent=Slider(1, range=0..1))  # -> Vector, Length
pl = PlaneNormal(Origin=pt_2, ZAxis=vec.Vector)
geo = Geometry(cyl)
sec = BrepPlane(Brep=geo, Plane=pl)  # -> Curves, Points

# ---- group: create non-planar toolpaths / bottom edge
geo_2 = Geometry(geo)
edges = BrepEdges(Brep=geo_2)  # -> Naked, Interior, NonManifold
item = ListItem(List=edges.Naked, Index=0, Wrap=True)

# ---- group: create non-planar toolpaths / top edge
Z = UnitZ(Factor=total_height_2)
move = Move(Geometry=item, Motion=Z)  # -> Geometry, Transform

# ---- group: create contours at every layer
series = Series(Start=0, Step=layer_height, Count=num_layers)
geo_3 = Geometry(cyl)
contour = ContourEx(Shape=geo_3, Plane=PlaneXY(0, 0, 0), Offsets=series)

# ---- group: create 2nd shell
geo_4 = Geometry(cyl)
offset = OffsetSurface(Surface=geo_4, Distance=layer_height, Retrim=True)
contour_2 = ContourEx(Shape=offset, Plane=PlaneXY(0, 0, 0), Offsets=series)

# ----
simple_toolpath = Curve(contour)
crv = Curve(move.Geometry)
crv_2 = Curve(sec.Curves)
crv_3 = Curve(item)

# ---- group: combine inner & outer toolpaths
outer_shell = Curve(contour_2)
weave = Weave(Pattern=[0, 1], Stream0=simple_toolpath, Stream1=outer_shell, NullGaps=False)

# ---- group: use to verify order
item_2 = ListItem(List=flatten(weave), Index=Slider(5, range=0..10), Wrap=False)

# ---- group: top sections
divide = DivideCurve(Curve=crv_2, Count=curve_resolution, Kinks=False)  # -> Points, Tangents, Parameters
divide_2 = DivideCurve(Curve=crv, Count=curve_resolution, Kinks=False)  # -> Points, Tangents, Parameters
num_layers_2 = Number(num_layers)
ln = Line(StartPoint=divide_2.Points, EndPoint=divide.Points)
divide_3 = DivideCurve(Curve=ln, Count=expr("x/2", num_layers_2), Kinks=False)  # -> Points, Tangents, Parameters
flip = FlipMatrix(Data=divide_3.Points)
pline = PolyLine(Vertices=flip, Closed=True)  # -> flatten(Polyline)
crv_4 = Curve(reverse(pline))

# ---- group: bottom sections
divide_4 = DivideCurve(Curve=crv_3, Count=curve_resolution, Kinks=False)  # -> Points, Tangents, Parameters
divide_5 = DivideCurve(Curve=crv_2, Count=curve_resolution, Kinks=False)  # -> Points, Tangents, Parameters
num_layers_3 = Number(num_layers)
ln_2 = Line(StartPoint=divide_5.Points, EndPoint=divide_4.Points)
divide_6 = DivideCurve(Curve=ln_2, Count=expr("x/2", num_layers_3), Kinks=False)  # -> Points, Tangents, Parameters
flip_2 = FlipMatrix(Data=divide_6.Points)
pline_2 = PolyLine(Vertices=flip_2, Closed=True)  # -> flatten(Polyline)
crv_5 = Curve(reverse(pline_2))

# ---- group: top sections / remove the first curve
lng = ListLength(List=crv_4)
dom = ConstructDomain(DomainStart=1, DomainEnd=lng)
subset = SubList(List=crv_4, Domain=dom, Wrap=False)  # -> List, Index

# ---- group: bottom sections / remove the last curve
lng_2 = ListLength(List=crv_5)
dom_2 = ConstructDomain(DomainStart=0, DomainEnd=expr("x-1", lng_2))
subset_2 = SubList(List=crv_5, Domain=dom_2, Wrap=False)  # -> List, Index

# ----
non_planar_toolpath = Curve([subset_2.List, subset.List])

# ---- group: use to verify order
item_3 = ListItem(List=non_planar_toolpath, Index=Slider(0, range=0..150), Wrap=False)

# ----
double_shell_toolpath = Curve(flatten(weave))
simple_toolpath_2 = Curve(flatten(simple_toolpath))
divide_7 = DivideCurve(Curve=double_shell_toolpath, Count=curve_resolution_3, Kinks=False)  # -> Points, Tangents, Parameters
divide_8 = DivideCurve(Curve=non_planar_toolpath, Count=curve_resolution_2, Kinks=False)  # -> Points, Tangents, Parameters

# ---- group: use to verify order
item_4 = ListItem(List=flatten(divide_8.Points), Index=Slider(0, range=0..150), Wrap=False)
sph = Sphere(Base=item_4, Radius=1)

# ----
divide_9 = DivideCurve(Curve=simple_toolpath_2, Count=curve_resolution_4, Kinks=False)  # -> Points, Tangents, Parameters

# ---- group: make plane through curve / get centroid
ma = MassAddition(Input=divide_8.Points)  # -> Result, PartialResults
lng_3 = ListLength(List=divide_8.Points)
division_2 = Division(A=ma.Result, B=lng_3)

# ---- group: make plane through curve
item_5 = ListItem(List=divide_8.Points, Index=expr("x/4", curve_resolution_2), Wrap=True)
item_6 = ListItem(List=divide_8.Points, Index=curve_resolution_2, Wrap=True)
pt_3 = Point(flatten(item_6))
pt_4 = Point(flatten(item_5))
pt_5 = Point(flatten(division_2))
pl_3pt = Plane3Pt(PointA=pt_5, PointB=pt_3, PointC=pt_4)

# ----
flip_3 = FlipMatrix(Data=divide_8.Points)
vec2pt = Vector2Pt(PointA=pl_3pt, PointB=simplify(flip_3), Unitize=False)  # -> Vector, Length
move_2 = Move(Geometry=pl_3pt, Motion=vec2pt.Vector)  # -> Geometry, Transform
pl_2 = PlaneNormal(Origin=divide_7.Points, ZAxis=Vector(0, 0, 1))
pl_3 = PlaneNormal(Origin=divide_9.Points, ZAxis=Vector(0, 0, 1))
vdis = VectorDisplay(Anchor=pl_3pt, Vector=vec2pt.Vector)
final_double_shell_toolpath = Plane(flatten(pl_2))
flip_4 = FlipMatrix(Data=move_2.Geometry)

# ---- group: use to verify order
item_7 = ListItem(List=flatten(final_double_shell_toolpath), Index=Slider(0, range=0..150), Wrap=False)
sph_2 = Sphere(Base=item_7, Radius=1)

# ----
final_simple_toolpath = Plane(flatten(pl_3))

# ---- group: use to verify order
item_8 = ListItem(List=flatten(final_simple_toolpath), Index=Slider(18, range=0..150), Wrap=False)
sph_3 = Sphere(Base=item_8, Radius=1)

# ----
final_non_planar_toolpath = Plane(flatten(flip_4))
planes_double_shell_toolpath = Plane(final_double_shell_toolpath)
planes_non_planar_toolpath = Plane(final_non_planar_toolpath)
planes_simple_toolpath = Plane(final_simple_toolpath)
lin_move = LINearMovementKUKAPrc(TargetAsPlane=planes_non_planar_toolpath, Speed=Slider(0.1, range=0..1), extaxenabled=False, interpolation="C_DIS")
kuka_prc = KUKAPrcCORE(
    SimulationSlider=Slider(0.51, range=0..1),
    KUKAPrcCommands=lin_move,
    Robot=kr10_r1420,
    PRC_BaseExpose=False,
    PRC_SaveNameExpose=False,
    PRCsettings="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")  # -> RobotGeometry, AnalysisOutput
