# Grasshopper definition test_multi_layer_height.gh (Grasshopper 1.0.7)

# ---- group: Global Parameters
# Modify Global Parameters Here!
layer_height = Slider(5, range=0.1..25)
max_speed = Slider(0.04, range=0..0.1)
min_speed = Slider(0.02, range=0..0.1)

# ---- group: Create Test Curves
phase = Slider(10, range=0..12)
height = Slider(21.945, range=1..360)
resolution = Slider(60, range=1..360)
z_offset = Slider(59.59, range=0..1000)
layer_height_2 = Number(layer_height)
cir = Circle(Plane=PlaneXY(0, 0, 0), Radius=Slider(175, range=50..1000))
pi = Pi(Factor=phase)
Z = UnitZ(Factor=layer_height_2)
generate_top_profile = GenerateTopProfile(crv=cir, N=resolution, D=pi, y=height, F=z_offset)
move_curves = MoveCurves(G=[generate_top_profile, cir], T=Z)  # -> i, i_2

# ---- group: Generate Surface
loft_opt = LoftOptions(Closed=False, Adjust=False, Rebuild=resolution, Refit=0, Type=0)
base_curve = Curve(move_curves.i)
top_curve = Curve(move_curves.i_2)
loft = Loft(Curves=flatten([base_curve, top_curve]), Options=loft_opt)

# ---- group: Create Toolpath Points
resolution_2 = Integer(resolution)
srf = Surface(loft)
sdivide = DivideSurface(Surface=srf, UCount=10, VCount=resolution_2)  # -> Points, Normals, Parameters
get_tallest_isocurve = GetTallestIsocurve(D=sdivide.Points)
layer_height_3 = Number(layer_height)
crv = Curve(get_tallest_isocurve)
srf_2 = Surface(srf)
generate_toolpaths = GenerateToolpaths(C=crv, L=layer_height_3, S=srf_2)

# ---- group: Create Toolpath Points / Rebuild with Twice Resolution
_2_resolution = Integer(expr("x*2", resolution_2))
crv_2 = Curve(generate_toolpaths)
divide = DivideCurve(Curve=crv_2, Count=_2_resolution, Kinks=False)  # -> Points, Tangents, Parameters

# ---- group: Create Toolpath Points (continued)
toolpath_points = Point(divide.Points)

# ---- group: Map Layer Height to Min / Max Velocities
toolpath_points_2 = Point(toolpath_points)
get_min_max_layer_heights = GetMinMaxLayerHeights(D=toolpath_points_2)  # -> i, i_2, L
vector_length = Number(get_min_max_layer_heights.L)
min_height = Number(get_min_max_layer_heights.i)
max_height = Number(get_min_max_layer_heights.i_2)
max_velocity = Number(max_speed)
min_velocity = Number(min_speed)
map_layer_heigh_to_velocity = MapLayerHeighToVelocity(V=vector_length, A=min_height, B=max_height, A_2=max_velocity, B_2=min_velocity)
panel = Panel(map_layer_heigh_to_velocity)
mapped_velocities = Number(flatten(panel))

# ---- group: Spiralize the Middle Section
_2_resolution_2 = Integer(expr("x*2", resolution_2))
toolpath_points_3 = Point(toolpath_points)
spiralize = Spiralize(D=toolpath_points_3, N=_2_resolution_2)
spiralized_points = Point(spiralize)
points = PointList(Points=spiralized_points)

# ---- group: Base Curve
_2_resolution_3 = Integer(expr("x*2", resolution_2))
base_curve_2 = Curve(base_curve)
divide_2 = DivideCurve(Curve=base_curve_2, Count=_2_resolution_3, Kinks=False)  # -> Points, Tangents, Parameters
base_points = Point(flatten(divide_2.Points))
points_2 = PointList(Points=base_points)

# ---- group: Top Curve
_2_resolution_4 = Integer(expr("x*2", resolution_2))
top_curve_2 = Curve(top_curve)
divide_3 = DivideCurve(Curve=top_curve_2, Count=_2_resolution_4, Kinks=False)  # -> Points, Tangents, Parameters
top_points = Point(flatten(divide_3.Points))
points_3 = PointList(Points=top_points)

# ---- group: Top Layer Uses the Last Row of Spiralized Velocities
flip = FlipMatrix(Data=map_layer_heigh_to_velocity)
lng = ListLength(List=flip)
item = ListItem(List=flip, Index=expr("x-1", lng), Wrap=True)
flip_2 = FlipMatrix(Data=item)
top_velocities = Number(flatten(flip_2))

# ---- group: Base Layer Uses Min Velocity
min_velocity_2 = Number(min_speed)
lng_2 = ListLength(List=base_points)
series = Series(Start=min_velocity_2, Step=0, Count=lng_2)
base_velocities = Number(flatten(series))

# ---- group: Toolpath Velocities
spiralized_velocities = Number(mapped_velocities)
base_velocities_2 = Number(base_velocities)
top_velocities_2 = Number(top_velocities)
merge_vels = Merge(Data1=base_velocities_2, Data2=spiralized_velocities, Data3=top_velocities_2)

# ---- group: Toolpath Points
spiralized_points_2 = Point(spiralized_points)
base_points_2 = Point(base_points)
top_points_2 = Point(top_points)
merge_points = Merge(Data1=base_points_2, Data2=spiralized_points_2, Data3=top_points_2)

# ---- group: Visualize Velocities
min_velocity_3 = Number(min_speed)
max_velocity_2 = Number(max_speed)
pline = PolyLine(Vertices=merge_points, Closed=False)
gradient = Gradient(
    LowerLimit=min_velocity_3,
    UpperLimit=max_velocity_2,
    Parameter=merge_vels,
    stops=[0.151: RGB(255, 0, 255), 0.852: RGB(51, 153, 255)])
explode = Explode(Curve=pline, Recursive=True)  # -> Segments, Vertices
end = EndPoints(Curve=explode.Segments)  # -> Start, End
ln = Line(StartPoint=end.Start, EndPoint=end.End)
preview = CustomPreview(Geometry=ln, Material=gradient)

# ---- group: Connect to KUKA|PRC
toolpath_points_4 = Point(merge_points)
toolpath_velocities = Number(merge_vels)
xy = XYPlane(Origin=toolpath_points_4)

# ==== cluster GenerateTopProfile
crv = ClusterInput()
N = ClusterInput()
D = ClusterInput()
y = ClusterInput()
F = ClusterInput()
range = Range(Domain=D, Steps=N)
lng = ListLength(List=range)  # -> expr("x-2", Length)
crv_2 = Curve(crv)
subset = SubList(List=range, Domain=lng, Wrap=False)  # -> List, Index
divide = DivideCurve(Curve=crv_2, Count=N, Kinks=False)  # -> Points, Tangents, Parameters
pdecon = Deconstruct(Point=divide.Points)  # -> XComponent, YComponent, ZComponent
eval = Evaluate(F="y * sin(x)", x=subset.List, y=y)
pt = ConstructPoint(XCoordinate=pdecon.XComponent, YCoordinate=pdecon.YComponent, ZCoordinate=eval)
points = PointList(Points=pt, Size=Slider(5.5, range=1..10))
pline = PolyLine(Vertices=pt, Closed=True)
Z = UnitZ(Factor=F)
move = Move(Geometry=pline, Motion=Z)  # -> Geometry, Transform
G = ClusterOutput(move.Geometry)

# ==== cluster GetTallestIsocurve
D = ClusterInput()
flip = FlipMatrix(Data=D)
pline = PolyLine(Vertices=flip, Closed=False)
len = Length(Curve=flatten(pline))
sort = SortList(Keys=len)  # -> reverse(Keys), ValuesA
item = ListItem(List=sort.Keys, Index=0, Wrap=True)
equals = Equality(FirstNumber=len, SecondNumber=item)  # -> Equality, Inequality
cull = CullPattern(List=flatten(pline), CullPattern=equals.Equality)
L = ClusterOutput(cull)

# ==== cluster GenerateToolpaths
C = ClusterInput()
L = ClusterInput()
S = ClusterInput()
divlength = DivideLength(Curve=C, Length=L)  # -> Points, Tangents, Parameters
srf_cp = SurfaceClosestPoint(Point=divlength.Points, Surface=S)  # -> Point, UVPoint, Distance
iso = IsoCurve(Surface=S, UVPoint=srf_cp.UVPoint)  # -> UIsocurve, VIsocurve
V = ClusterOutput(iso.VIsocurve)

# ==== cluster GetMinMaxLayerHeights
D = ClusterInput()
flip = FlipMatrix(Data=D)
lng = ListLength(List=flip)
pline = PolyLine(Vertices=flip, Closed=False)
_0 = DomainStart(0)
_1 = DomainStart(1)
dom = ConstructDomain(DomainStart=_1, DomainEnd=expr("x-1", lng))
dom_2 = ConstructDomain(DomainStart=_0, DomainEnd=expr("x-2", lng))
subset = SubList(List=flip, Domain=dom, Wrap=False)  # -> List, Index
subset_2 = SubList(List=flip, Domain=dom_2, Wrap=False)  # -> List, Index
vec2pt = Vector2Pt(PointA=subset_2.List, PointB=subset.List, Unitize=False)  # -> Vector, Length
vdisex = VectorDisplayEx(Point=subset_2.List, Vector=vec2pt.Vector, Colour=RGB(0, 0, 0), Width=2)
layer_heights = Number(flatten(vec2pt.Length))
sort = SortList(Keys=layer_heights)  # -> Keys, ValuesA
item = ListItem(List=reverse(sort.Keys), Index=0, Wrap=True)
item_2 = ListItem(List=sort.Keys, Index=0, Wrap=True)
i = ClusterOutput(item_2)
i_2 = ClusterOutput(item)
L = ClusterOutput(vec2pt.Length)

# ==== cluster MapLayerHeighToVelocity
A = ClusterInput()
B = ClusterInput()
A_2 = ClusterInput()
B_2 = ClusterInput()
V = ClusterInput()
dom = ConstructDomain(DomainStart=A, DomainEnd=B)
dom_2 = ConstructDomain(DomainStart=A_2, DomainEnd=B_2)
remap = RemapNumbers(Value=V, Source=dom, Target=dom_2)  # -> Mapped, Clipped
flip = FlipMatrix(Data=remap.Clipped)
D = ClusterOutput(flip)

# ==== cluster MoveCurves
G = ClusterInput()
T = ClusterInput()
move = Move(Geometry=G, Motion=T)  # -> flatten(Geometry), Transform
item = ListItem(List=move.Geometry, Index=0, Wrap=True)
i = ClusterOutput(item)
item_2 = ListItem(List=move.Geometry, Index=1, Wrap=True)
i_2 = ClusterOutput(item_2)

# ==== cluster Spiralize
D = ClusterInput()
flip = FlipMatrix(Data=D)
pline = PolyLine(Vertices=flip, Closed=False)  # -> flatten(Polyline)

# ---- group: Remove Top Row of Points
lng = ListLength(List=flip)
_0 = DomainStart(0)
dom = ConstructDomain(DomainStart=_0, DomainEnd=expr("x-2", lng))
subset = SubList(List=flip, Domain=dom, Wrap=False)  # -> List, Index
flip_2 = FlipMatrix(Data=subset.List)

# ----
explode = Explode(Curve=pline, Recursive=True)  # -> Segments, Vertices

# ---- group: Remove Top Segment
lng_2 = ListLength(List=explode.Segments)
_0_2 = DomainStart(0)
dom_2 = ConstructDomain(DomainStart=_0_2, DomainEnd=expr("x-2", lng_2))
subset_2 = SubList(List=explode.Segments, Domain=dom_2, Wrap=False)  # -> List, Index

# ----
N = ClusterInput()

# ---- group: Move Up to Spiralize
end = EndPoints(Curve=subset_2.List)  # -> Start, End
vec2pt = Vector2Pt(PointA=end.Start, PointB=end.End, Unitize=False)  # -> Vector, Length
range = Range(Domain=Domain(0, 1), Steps=expr("x-1", N))
vdis = VectorDisplay(Anchor=end.Start, Vector=vec2pt.Vector)
flip_3 = FlipMatrix(Data=vec2pt.Vector)
multiplication = Multiplication(A=flip_3, B=range)
move = Move(Geometry=flip_2, Motion=multiplication)  # -> flatten(Geometry), Transform

# ----
G = ClusterOutput(move.Geometry)
